# Grasshopper definition forma-api.gh (Grasshopper 1.0.7)
# Copyright: 2024
# plug-ins: Formicae, Swiftlet

panel = Panel("https://app.autodeskforma.eu/designmode/pro_74nzjy4r4h/51001399-12b2-4ad5-87a8-6e7772e3fdad")
brep = Brep(<brep referenced from the Rhino model>)
create_simulation_box = CreateSimulationBox(Box=brep)  # -> SimulationPoints, ResultMeshGrid, SimulationBox
mesh = Mesh(<mesh referenced from the Rhino model>)
brep_2 = Brep([<brep referenced from the Rhino model> x4])
auth = Auth(Trigger=Button())
gh_createwindsimulationmodel = GH_CreateWindSimulationModel(TerrainMesh=mesh, BuildingsBreps=brep_2, SimulationBox=create_simulation_box.SimulationBox)
clean = CleanTree(RemoveNulls=True, RemoveInvalid=True, RemoveEmpty=False, Tree=auth)
data = Data(flatten(clean))
python = GhPythonScript()  # -> out, key, value
# ---------- python: Python ----------
import rhinoscriptsyntax as rs

ghenv.Component.Message = "x-ads-region"


key = "x-ads-region"
value = "EMEA"
# ---------- end python ----------
python_2 = GhPythonScript(url=panel)  # -> out, key, value
# ---------- python_2: Python ----------
import rhinoscriptsyntax as rs

ghenv.Component.Message = "authcontext"
urlParts = url.split("/")

key = "authcontext"
value = urlParts[-2]
# ---------- end python_2 ----------
bearer = BearerTokenAuth(Token=data)
python_3 = GhPythonScript()  # -> out, endPoint
# ---------- python_3: Python ----------
__author__ = "ARZE"
__version__ = "2024.02.14"

import rhinoscriptsyntax as rs
ghenv.Component.Message = "Wind params end point"
endPoint  = "https://developer.api.autodesk.com/forma/wind-prediction/v1alpha/parameters"
# ---------- end python_3 ----------
cqp = CreateQueryParam(Key=python_2.key, Value=python_2.value)
ch = CreateHttpHeader(Key=python.key, Value=python.value)
gh_createheightmaps = GH_CreateHeightMaps(WindSimModel=gh_createwindsimulationmodel)  # -> HeightsMapWithoutBuildings, HeightsMapWithBuildings
merge = Merge(Data1=bearer, Data2=ch)
get = GETRequest(URL=python_3.endPoint, Params=cqp, Headers=merge)  # -> Status, Content, Response
dam = DataDam(DataA=gh_createheightmaps.HeightsMapWithoutBuildings, BufferDelay=10000000, BufferMode=0)
dam_2 = DataDam(DataA=gh_createheightmaps.HeightsMapWithBuildings, BufferDelay=10000000, BufferMode=0)
python_4 = GhPythonScript(wind_param=get.Content, terrainHeightArray=dam, buildingAndTerrainHeightArray=dam_2)  # -> out, body_dump; inputs terrainHeightArray: list, buildingAndTerrainHeightArray: list
# ---------- python_4: Python ----------
__author__ = "ARZE"
__version__ = "2024.02.13"

import rhinoscriptsyntax as rs
import json

body = dict()
type = "comfort"
#"roughness": 0.6065,
comfortScale = "lawson_lddc"


wind_param_parts = json.loads(wind_param)
roughness = wind_param_parts["roughness"]
heightMaps  = {
        "terrainHeightArray": [0 for i in range(250000)],
        "minHeight": -5.7272000915399985,
        "maxHeight": 261.58963123445756,
        "buildingAndTerrainHeightArray":[0 for i in range(250000)]
    }
    
    

    
del wind_param_parts["roughness"]


body["heightMaps"] = heightMaps
body["windRose"] = wind_param_parts
body["type"] = type
body["roughness"] = roughness
body["comfortScale"] = comfortScale

body_dump = json.dumps(body)
# ---------- end python_4 ----------

# ---- group: Remapped values Without
construct_domain = ConstructDomain(DomainStart="0", DomainEnd="255")
bounds = Bounds(Numbers=gh_createheightmaps.HeightsMapWithoutBuildings)
remap_numbers = RemapNumbers(Value=gh_createheightmaps.HeightsMapWithoutBuildings, Source=bounds, Target=construct_domain)  # -> Mapped, Clipped

# ---- group: Model With Bldgs
ghpython_script = GhPythonScript(x=gh_createwindsimulationmodel)  # -> out, a; disabled
# ---------- ghpython_script: Python ----------
__author__ = "mm1039"
__version__ = "2024.02.14"

import rhinoscriptsyntax as rs

a = x.ModelWithBuildings
# ---------- end ghpython_script ----------

# ---- group: ModelWithoutBuilding
ghpython_script_2 = GhPythonScript(x=gh_createwindsimulationmodel)  # -> out, a; disabled
# ---------- ghpython_script_2: Python ----------
__author__ = "mm1039"
__version__ = "2024.02.14"

import rhinoscriptsyntax as rs

a = x.ModelwithoutBuildings
# ---------- end ghpython_script_2 ----------

# ---- group: Result mesh draped
ghpython_script_3 = GhPythonScript(x=gh_createwindsimulationmodel)  # -> out, a; disabled
# ---------- ghpython_script_3: Python ----------
__author__ = "mm1039"
__version__ = "2024.02.14"

import rhinoscriptsyntax as rs

a = x.GetResultMeshDraped()
# ---------- end ghpython_script_3 ----------

# ----
python_5 = GhPythonScript()  # -> out, endPoint
# ---------- python_5: Python ----------
__author__ = "ARZE"
__version__ = "2024.02.14"

import rhinoscriptsyntax as rs
ghenv.Component.Message = "Predict end point"
endPoint  = "https://developer.api.autodesk.com/forma/wind-prediction/v1alpha/predict"
# ---------- end python_5 ----------
ctb = CreateTextBody(
    Content=python_4.body_dump,
    IsHtmlChecked=False,
    IsJavascriptChecked=False,
    IsJsonChecked=True,
    IsTextChecked=False,
    IsXmlChecked=False)

# ---- group: Remapped with buildings
bounds_2 = Bounds(Numbers=gh_createheightmaps.HeightsMapWithBuildings)
construct_domain_2 = ConstructDomain(DomainStart="0", DomainEnd="255")
remap_numbers_2 = RemapNumbers(Value=gh_createheightmaps.HeightsMapWithBuildings, Source=bounds_2, Target=construct_domain_2)  # -> Mapped, Clipped

# ----
post = POSTRequest(URL=python_5.endPoint, Body=ctb, Params=cqp, Headers=merge)  # -> Status, Content, Response; disabled

# ---- group: Min and max
bounds_3 = Bounds(Numbers=gh_createheightmaps.HeightsMapWithBuildings)
deconstruct_domain = DeconstructDomain(Domain=bounds_3)  # -> Start, End
